# Grasshopper definition library waffle.gh (Grasshopper 0.9.76)

# ---- group: ribs
# given surface
thick = Slider(19.5, range=0..30)
X = Slider(170, range=0..500)
Y = Slider(170, range=0..500)
brep = Brep(<brep referenced from the Rhino model>)
yz = YZPlane(Origin=Point(0, 0, 0))
xz = XZPlane(Origin=Point(0, 0, 0))
contour = Contour(Shape=brep, Point=xz, Direction=xz, Distance=X)
contour_2 = Contour(Shape=brep, Point=yz, Direction=yz, Distance=Y)
X_2 = UnitX(Factor=thick)
planar = PlanarSrf(Edges=contour)
Y_2 = UnitY(Factor=thick)
planar_2 = PlanarSrf(Edges=contour_2)
extr = Extrude(Base=planar, Direction=Y_2)
extr_2 = Extrude(Base=planar_2, Direction=X_2)
flatten = FlattenTree(Data=extr, Path="{0}")
flatten_2 = FlattenTree(Data=extr_2, Path="{0}")
flatten_3 = FlattenTree(Tree=planar, Path="{0}")
graft = GraftTree(Tree=planar_2, IncludeEmptyLists=True, IncludeNullItems=True)

# ----
bbox = BoundingBox(Content=brep, Plane=PlaneXY(0, 0, 0))  # -> Box, Box_2
bbx = BrepBrep(BrepA=flatten_3, BrepB=graft)  # -> Curves, Points
explode = BrepComponents(Brep=bbox.Box)  # -> Faces, Edges, Vertices
bbox_2 = BoundingBox(Content=bbx.Curves, Plane=PlaneXY(0, 0, 0))  # -> Box, Box_2
box = EvaluateBox(Box=bbox_2.Box, UParameter=0.5, VParameter=0.5, WParameter=0.5)  # -> Plane, Point, Include
pt = Point(box.Point)

# ---- group: notches Y
i = Index(4)
item = ListItem(List=explode.Faces, Index=i, Wrap=True)
project = Project(Geometry=pt, Plane=item)  # -> Geometry, Transform
dist = Distance(PointA=pt, PointB=project.Geometry)
B = B(-1)
multiplication = Multiplication(A=dist, B=B)
box_2 = DomainBox(Base=pt, X=thick, Y=thick, Z=multiplication)
flatten_4 = FlattenTree(Data=box_2, Path="{0}")
sdiff = SolidDifference(BrepsA=flatten_2, BrepsB=flatten_4)
preview = CustomPreview(Geometry=sdiff, Shader=ColourSwatch(SwatchColor=RGB(107, 107, 107)))

# ---- group: notches X
i_2 = Index(5)
item_2 = ListItem(List=explode.Faces, Index=i_2, Wrap=True)
project_2 = Project(Geometry=pt, Plane=item_2)  # -> Geometry, Transform
dist_2 = Distance(PointA=pt, PointB=project_2.Geometry)
box_3 = DomainBox(Base=pt, X=thick, Y=thick, Z=dist_2)
flatten_5 = FlattenTree(Data=box_3, Path="{0}")
sdiff_2 = SolidDifference(BrepsA=flatten, BrepsB=flatten_5)  # -> simplify(Result)
preview_2 = CustomPreview(Geometry=sdiff_2, Shader=ColourSwatch(SwatchColor=RGB(20, 20, 20)))

# ----
number_slider = Slider(2, range=0..10)

# ---- group: unroll X
explode_2 = BrepComponents(Brep=sdiff_2)  # -> Faces, Edges, Vertices
item_3 = ListItem(List=explode_2.Faces, Index=number_slider, Wrap=True)
item_4 = ListItem(List=explode_2.Vertices, Index=number_slider, Wrap=True)
lng = ListLength(List=flatten(item_3))
number_slider_2 = Slider(1000, range=0..2000)
division = Division(A=lng, B=1.5)
series = Series(Start=0, Step=1, Count=lng)
subtraction = Subtraction(A=division, B=1)
str = String("A")
int = Integer(series)
f_x_y = F2(Function="X&Y", X=str, Y=int)
X_3 = UnitX(Factor=-500)
recgrid = Rectangular(Plane=PlaneXY(0, 0, 0), SizeX=number_slider_2, SizeY=number_slider_2, ExtentX=1, ExtentY=subtraction)  # -> Cells, Points
move = Move(Geometry=recgrid.Points, Motion=X_3)  # -> Geometry, Transform
tag = TextTag(Location=flatten(item_4), Text=flatten(f_x_y))
graft_2 = GraftTree(Tree=move.Geometry, IncludeEmptyLists=True, IncludeNullItems=True)
graft_3 = GraftTree(Tree=item_4, IncludeEmptyLists=True, IncludeNullItems=True)
vec2pt = Vector2Pt(PointA=graft_3, PointB=graft_2, Unitize=False)  # -> Vector, Length
move_2 = Move(Geometry=item_3, Motion=vec2pt.Vector)  # -> Geometry, Transform
xy = XYPlane(Origin=graft_2)
X_4 = UnitX(Factor=1)
tag_2 = TextTag(Location=flatten(graft_2), Text=flatten(f_x_y))
int_2 = Integer(90)
graft_4 = GraftTree(Data=flatten(move_2.Geometry), Strip=False)
rad = Radians(Degrees=int_2)
yz_2 = YZPlane(Origin=graft_2)
move_3 = Move(Geometry=xy, Motion=X_4)  # -> Geometry, Transform
Y_3 = UnitY(Factor=-1.5)
rotate = Rotate(Geometry=graft_4, Angle=rad, Plane=graft(yz_2))  # -> Geometry, Transform
move_4 = Move(Geometry=move_3.Geometry, Motion=Y_3)  # -> Geometry, Transform
wires = BrepWireframe(Brep=rotate.Geometry, Density=-1)
tag_3 = TextTag3D(Location=flatten(move_4.Geometry), Text=flatten(f_x_y), Size=Slider(69, range=0..100), Justification=7)

# ---- group: unroll Y
explode_3 = BrepComponents(Brep=sdiff)  # -> Faces, Edges, Vertices
item_5 = ListItem(List=explode_3.Faces, Index=0, Wrap=True)
item_6 = ListItem(List=explode_3.Vertices, Index=0, Wrap=True)
lng_2 = ListLength(List=flatten(item_5))
number_slider_3 = Slider(1816, range=0..2000)
division_2 = Division(A=lng_2, B=2)
series_2 = Series(Start=0, Step=1, Count=lng_2)
subtraction_2 = Subtraction(A=division_2, B=1)
str_2 = String("B")
int_3 = Integer(series_2)
recgrid_2 = Rectangular(Plane=PlaneXY(0, 0, 0), SizeX=number_slider_3, SizeY=number_slider_3, ExtentX=1, ExtentY=subtraction_2)  # -> Cells, Points
X_5 = UnitX(Factor=-800)
f_x_y_2 = F2(Function="X&Y", X=str_2, Y=int_3)
tag_4 = TextTag(Location=flatten(item_6), Text=flatten(f_x_y_2))
move_5 = Move(Geometry=recgrid_2.Points, Motion=X_5)  # -> Geometry, Transform
graft_5 = GraftTree(Tree=move_5.Geometry, IncludeEmptyLists=True, IncludeNullItems=True)
tag_5 = TextTag(Location=flatten(move_5.Geometry), Text=flatten(f_x_y_2))
vec2pt_2 = Vector2Pt(PointA=item_6, PointB=graft_5, Unitize=False)  # -> Vector, Length
xy_2 = XYPlane(Origin=graft_5)
X_6 = UnitX(Factor=-4.5)
move_6 = Move(Geometry=item_5, Motion=vec2pt_2.Vector)  # -> Geometry, Transform
int_4 = Integer(90)
Y_4 = UnitY(Factor=1.5)
move_7 = Move(Geometry=xy_2, Motion=X_6)  # -> Geometry, Transform
yz_3 = YZPlane(Origin=graft_2)
xz_2 = XZPlane(Origin=move_5.Geometry)
rad_2 = Radians(Degrees=int_4)
graft_6 = GraftTree(Tree=move_6.Geometry, IncludeEmptyLists=True, IncludeNullItems=True)
move_8 = Move(Geometry=move_7.Geometry, Motion=Y_4)  # -> Geometry, Transform
rotate_2 = Rotate(Geometry=graft_6, Angle=rad_2, Plane=graft(xz_2))  # -> Geometry, Transform
wires_2 = BrepWireframe(Brep=rotate_2.Geometry, Density=-1)
tag_6 = TextTag3D(Location=flatten(move_8.Geometry), Text=flatten(f_x_y_2), Size=Slider(69, range=0..100), Justification=7)
